# Grasshopper definition 12_garden_fence.gh (Grasshopper 1.0.8)
# plug-ins: RhinoCodePluginGH, treesloth01, ShapeDiverForGrasshopper, eleFront

sddp = ShapeDiverDocumentPayload({AbsoluteTolerance=0, AngleTolerance=0, DistanceDisplayPrecision=0, GltfVersion="Gltf2", GrasshopperVersion="1.0.0008", InputGroups="{}", OutputGroups="{}", RelativeTolerance=0, RhinoVersion="8.12.24282.7001", UnitSystem=0, VersionCreated="1.21.0.0", VersionSaved="1.21.0.0"})
# Example0
panel = Panel("""AAAA
BBCD
BBCC
EEEC""")
# RealInput
panel_2 = Panel("""SSSSSSSSSSSSSSSWWWWWHHHHHHHHHHHHHHHHHHBBBJJJJJJJJJIJUUUUUUUUUOOOOOOOOOHHHHHHHHHGGGGGGGGGGGGGGGGTTTTTTTTTTZZZHHSSHHHEEEEEEEETTTTTTTTTTOOOOOOO
SSSSSSSSSSSSSSSWWWWWWHHHHHHHHHHHHHHHHHBBJJJJJJJJJJJJUUUUUUUOOOOOOOOOOOOHHHHHHHHHGGGGGGGGGGTTTGTTTTTTTTTTZZHHHSSSHHEEEEEEEEETTTTTTTTTTTTOOOOO
SSSSSSSSSSSSAAWWWWWWWBBBBHBBBHHHHHHHHHJJJJJJJJJJJJJUUUUUUUPOCOOOOOOOOOOHHHHHHHHHGGGGGGGGGGGTTTTTTTTTTTTTZHHHHHHSHHHHEEEEEEETTTTTTTTTTTOOOOOO
SSSSSSSSSSSSAAAAAWRWBBBBBBBBBHHHHHHHHHJJJJJJJJJJJJJJUUUPPPPPPSOOOOOOOOOHOOOOHHHGGGGGGGGGGGGTTTTTTTTTTTTTHHHHHHHHHHHHBBEEEEETTTTTTTTTTTTOOOOO
SSSSSSSSSSAAAAAAAWRWWBBBBBBHHHHHHHHHHHJJJCJJJJJJJJJJUUUUPPPPPOOOOOOOOOOOOOOOHHHGGGGGGGGGGGGTTTTTTTTTTTTTHHHHHHHHHHHBBBBBEEETTTTTTTTOOOOOOOOO
SSSSSSSSAAAAAAAARRRWBBBBBBBHHHHHHHHHHHJJJJJJJJJJJJJJUUUUPPPPPOOOOOOOOOOOOOOOHGHGGGGGGGGGGGGETTTTTTTTTTTTHHHHHHHHEHHBBBBBEEEEEOHTTTTOOOOOOOOO
SSSSSSSAAAAAAAARRRRBBAABBBZZHHHHHHHHCCXXJJJJJJJJJJUUUUUUPPPPPPPOOOOOOOOOOOOOGGGBGGGGGGGGGGGETTTTTTTTTTTTHHGGGHHHHBBBBBBBEEEEEOOTOTOOOOOOOOOO
SSSSSSSSAAAAAAARRRKBBAABBBEZHHHHHHHHHXXXJJJJJJJJJUUUUUUPPPUPPPPOOPOOOOOOOOSGGGGGGGGCGGGFFQFETTTTTTTTTTTPHHGGGGGHGBBBBBBBBEEEOOOOOOOOOOOOOOOO
SSSSSSSSSAAKKAAARRRAAAAAEEEEEHEHXHHHHXXXJXJXJJJJJUUUUUUUUUUPSPPOOPPOOOOOOOOOGGGGGGGGGLFFFQFTTTTTTTTTTTTPGGGGGGGGGBBBBBBEEEEEEEOUOOOOOOOOOOOO
CSSSSSSSSSSKAAAARRAAAAAAEEEEEEEXXXHHHXXXXXXXXJJJJJJUUUUUUUUUUUUUUUUUUOOOOOOGGGGGGGGGFFFFFFFTTTTTTTXTTTTLLGGGGGGGGGBBBEEEEEEEEOOUOOOOOOOOOOOO
CSSSSSSSSSKKKAAAAAAAAAAAEEEEEEEXXXHHXXXXXXXXXJJJJGGUUUUUUUUUUUUUUUUUUOOOOGGGGGGGGGGFFFFFFFFFFTTTTTTTLLTLGGGGGGGGGGBBBEPEEEEEPXXOOOOOOOOXXOOO
CSSSSSSSSKKKKAAAAAAAAEEEEEEEEPPEXXHXXXXXXXXXJJJJJJUUUUUUUSSUUUUUUUUUUOHHOGGAGGGGGGGFFFFFFFFFFTTGGGHHLLLLLLGGGGGGGGMBBPPEEEEEPPPPSOOOOOOXXXXX
CMSSSSSSSKKKKKKAAAAAAAEEEEEEPPPEEXXXXXXXXXXHUUJFFJUUUUUUSSSUUUUUUUUUUAAAAAAAGGGGEEEEEEFFFFFFFFFRRRRHHLLLLLLLGGGGGGGBBPPPPPPPPPPFOOOOXXXXXXXX
CCKSSSSSQQQKKKKAAAAAAAZEEEEEEEEEEEXXXXXXXXXHHHFFFUUUUUUUUUUUUUUUUUUUUAAAAAAAGGGGEEEEEEFFFFFFFFFRRRRRHLLLLLLLGGGGGGGGGGPPPPPPPPPWOOOXXXXXXXXX
CCKSSSSQQQQKKKKKAAAAZAZEEEEEEEEEEXXBXXXXXXXHLHHUUUUUUUUUUUUUUUUUUUUUUAAAAAGGGEEEEEEEEEEFFFFFFFFRRRRRHLLLLLGGGGGGGGGGGPPPPPPPPPWWOOOOXXXXXXXX
KCKKKKKKKKKKKKKKAAAAZZZEZEEEEEEEGBBBBXXXXHHHHHUUUUUUUUUUUUUUUUUUUUUUUAAAEEEEEEEEEEEEEEEEEEFFFFFHHHHHHHLLLLLLGGGGGGGPPPPPPPPPPPWWWOOOXXXXXXXX
KKKKKKKKKKKKKKKKAAAAZZZZZZEEEEGGGBBBBBBBXHHHHHHHUUUUUUUUUUUUUUUUUUUUUANAEEEEEEEEEEEEEEEEEEFFFFFHHHHLLHLLLLLLGGGGGJGTRYPYPPPPPWWVWWWXXXXXXXXX
KKKKKKKKKKKKKKKAAAAZZZZZZZEEEEGGBBBBBBBHHHHHHHHUUURCUUUUUUUUUUUUUUUUUAAJEEEEEEEEEEEEEEEEEEFFFHHHHHHLLLLLLLLLGGGGGJRRRYYYPPPWWWWWWWWXXXXXXXXN
KKKKKKKKKKKKKVKAAAAZZZZZZNEEEEGGBNBBBBBBBHHHHHHUURRCUUUUUUUUUUUUUUUUUJJJEEEEEEEEEEEEEEEEEEFHHHHHRHRILLLLLLLLGGGGGRRRRYYYYPWWWWWWWWWXUXXXPXNN
KKKKKKKKKEKEKKKAAAAZZZZZZEEEEGGBBBBBBBBBGGHHHHHHFCCCUUUUUUUUUUUUUUAAJJJJEEEEEEEEEEEEEEEEEEXHHHHHRRRRLLLLLLLLGGGGIRRRRYYYYPWWSWWWWWWWUUUUUUUN
KKKKYYKEEEEEKKKKAAAAZZZZZEEENNGBBLBSBBBBBGGBBHHBFFCCCVNNUUUUUUUNNAAJJJJJEEEEEEEEEEEEEEEFFFXXXHXXXRRRLLLLLLLLLLLYYYRRRYYYYPWYYWWWWWWUUUUUUUUN
KKKYYYKEEXEXXRKKKKIZZZZZZPEENNBBLLLBBBBBBGGBBBHBFCCCCCNNUUUUUUUNNAJJJJJJEEEEEEEEEEEEEEERXXXXXXXXXRRRLLLLVRLLYYYYYYRRRYYYYYYYYWWWWWWUUUUUUUUN
KRRYYYXXXXXXXXKKKKZZZZZZZZZZHHHHHLBBBBBBBBBBBBBBBFNNNNNNUUUUUUUNNJJJJJJJEEEEEEEEEEEEEEERRXXXXXXXXRRRRRLRRRRLLYYYYYYYYYYYYYYYYYWWWCCUUUUUUUUU
RRYYYXXXXXXXKKKKKKKZZJZZZZZZHHHHHBBBBBBBBBBBBBBFFFNNNNNNNNNUUUNNNJJJJJJJEEEEEEEEEEEEEEERRXXXXXXXXRRRRRRRRRRRLKYYYYYYYYYYYCYYYWWWWCKUUUUTTTTT
RRRYYXXXXXXXXXKKKKKZZJZZZZZZZHHHHBBBBBBBBBBBBFFFFFNNNNNNNNNNNNNNNJJJJJJJJCCCCDDEEEDDXXXXXXXXXXXXRRRRRRRRRRRRLKYYYYYYYYYYYCCCCCCWCCKUUTTTTTTT
YYYYLLXXXXXXXXKKKKKKZZZZZZZZHHHHBBBBBBBBBBBBBBFFFFNNNNNNNNNNNNNNNJJJJJJCCCCCDDDEEEDBBBYXXXXXXXXRRRRRRRRRRRRRLRYYYYYYYYYYYCCCCCCCCCCCUTTTTTTT
LLYLLLXXXXXXXKKKKKKKZZZZZZZZHHHBBBBBBBBBBBBBFFFFFFNNNNNNNNNNTTTTJJJJJJJCCCCDDDDDDDDDDBYYXXXXXXXRRRRRRRRRRRRRRRYYYYYYYYYYYYCCCCCCCCCCCTTTTTTT
LLLCLLLXXXXXXKKKKKKKZZZZZZZHHHHBBBBBBBBBBBBBFFFFFFNNNNNNNNNNTTTTDDDDDJJJJJCDDDDDDDDDDYYYXXXXXWRRRRRRRRRRRRRPPPYYDYYYYYYYYYYCCTCCCCCCCTTTTTTT
LLLLLLXXXXXXXKKKKKKKZZZZZZZZHHHBBBBBBBBBBBBFFFFFFLLLLLLLLLNNTTTTDDDDDJJJJJCDDDDDDDDDYYYYYYYYYRRRRRRRRRRRRRRRRPDDDDDDYYYYYYYYTTCCCCCCCTTTTTTT
LLLLLYYYXXXXXKKKKKHKZZZHHHHHHHBBBBBBBBBBBBBFFFFFLLLLLLLLLLNNTTTDDDDDDAJJJCCDDDDDDDDDDDYYYYYYYRPYWWRRRRRRRRCCRRDDDDDDYYYYYYYYTCCCCCCCCTTTTTTT
LLLLYYYYYYXXXKKKKKHHZZZHHHHHHHHHHBBBBBBBBBBZZFFFLLLLLLLLLLETETTDDDDDDAAAADDDDDDDDDDDDDYYYYYYYYPYWRRRRRRRRRCCCCCDDDDDDYYDYYYYTTCCCCCCCTTTTTTT
LLLYYYYYYYKXXKKJJHHHHZZHHHHHHHHHHHHBBBBYBBBZWHFFLLLLLLLLLLEEEEEEEDDDDDDADDDDDDDDDDDDDDYYYYYYYYYYWRRRRRRRRCCCCCCDDDDDDDDDYYDDCCCCCCCCGTTTTTTT
LLLLYYYYYYKKKKKJJHTHHHHHHHHHHHHHHHHOBBBYYBBZWHHHLLLLLLLLLLEEEEEEDDDDDDAADDDDDDDDDDDDDDYYKYYYYYYYYYRRRRRCCCCCCCCCDDDDDDDYYYDDDCCCCCCCGTTTTTTT
LLLLLYYYYYKKKKJJNHHHHHHHHHHHHHHHHHHONNNNNNNNWHAALLLLEEEEEEEEEEEEDDDDDAAAAAADDDDDDFFDDDDFFYYYYYYYYYRRRRQCCCCCCCPPPPPDDDDDYYDTTTTTTTTGGGTTTTTT
LLLLYYYYYYYZZJJJHHHHHHHIHHHHHHHHHOOONNNNNNNNWWAALLLLEAEEEEEEEEEEDDDDDDDTTTTDTDDDDFFDFFFFFNNYYYYYYLLLRCCCCCCCCCPPPPPPPDDDDDDTTTTTTTTTTTTTTTTT
LLLYYYYYYBZZZVZJJJJJJHHIIIHHHOHHOOOONNNNNNNNWAAALLLLAAEEEEEEEJEEDDDDDDDTTTTTTTDDDFFFFFFFFFNYYYYYYLLLLLCCCCCCCPPPPPPPPDDDDDDTTTTTTTTTTTTTTTTT
LLLYYYYYYBBZZZZJJJJHHHHIIIHHHOOOOOOONNNNNNNNWWAALLLLAAAEAEEEEEEEDYDDDTTTTTTTTPPDZFFFFFFFFFFUUUUYYLLLLLLCCCCCPPPPPPPPPDDDNNNNNNNTTTTTTTTTTTTT
LLYYYYYYYBBZZZZZJJJJJIHIIHHHHOOOOOOONNNNNNNNWWWWLLLLAAAAAAEYEEEEEYYYDTTTTTTTTPPAZFFFFFFFFFFUUUUYYYLLLCCCCPPPPPPPPPPPPPDXNNNNNNNTTTTTTTTTGGGX
LLLYYYYYBBZZZZZZJJJJIIIIIHHHHHHOOOOONNNNNNNNWWWWAAAAAAAAAAEEEHEEEYYYTTYTTTAAAPAAZFFFFFFFFFFFUUUYYYLLLCLLPPPPPPPPPPPPPPDXNNNNNNNNNTTTTTTTGGGX
LLLLLYYYYYZZZZZZJJJIIIIIIIIIHFHODOOONNNNNNNNAWWWAAAAAAAAAHHHEHHHEYYYYYYTTSAAAAAWFFFFFFFFFFFFUUUYYYLLLLLLPPPPPPPPPPPPYPDXNNNNNNNNNTTTTTTTGGXX
LLLLLLLYJJJJZZJJJJJIIIIIIIIIIFFFOOOOOONNNAAAWWWWWAAAAAAAAHHHHHHHEEYYYYYYYYAAAAAAAFFFFFFFFFFUUUURRLLLLLLLLPPPPPPPPPPPPPDPNNNNNNNNNTTTTTTTGGBB
LLLLLLLLLJJJZZJJJJJIIIIIIIIIIFFFOOOOOONNNOATTWWWWAAAAAAFFHHHHHHHYYYYYYYZYAAAAAAAAAFKFFFFFFFFFRRRRLLLLLLLLPPPPPPPPPPPNNNNNNNNNNNNNTTTTTTTGNBB
LLLLLLLBLJJJJJJJJJJIIIIIIIIIIFFFOOOOOONNNTTTTWWWWWAAAHHHHHHHHHHHYYYYYXZZZZZZAAAAAAFFFFFFFFRFRRRRRLLLLLLLLLLPPPPPPPPPNNNNNNNNNNNNNNBBBBBBGBBB
LLLLLLLLHHHJJJJJJCCCIIIIIIIIIIIFFFOOHHNNNOTTTWWWWWWLLSHHHHHHHHHYYYYYYXZZZZZZAAUAAAAFFFFFBFRRRRRRRRLYLLLLLPLPPPPPPPPPNNNNNNNNNNNNNNBBBBBBBBBB
LLLLLLLHHHHJJJJJJJCCIIIIIIIXIIIIFFFOFHNNNTTTTTTTTWWLLHHHHHHHHHHYYYYYYXZZZZZZZAAAAAAAAFFBBFRRRRRRRRLYYLLLLPPPPPPPPPPPNNNNNNNNNNNNNNBBBBBBBBBB
HLLLLLHHHHHHJHJJCCCCCCIIIIIXIIIFFFFFFFNNNTTTTTTTTTTLLHLHHHHHHHHVVVYXXXXXZZZZZJJJAJDDDFBBBFRRRRRRRRYYYLLLLPPPPPPPCPPPNNNNNNNNNNNNNNBBBBBBBBBB
HHHHLHHHHHHHHHJJCCCCCCTIXXXXXFFFFFFFFFTTTTTTTTTTTLLLLLLHHVHHVHVVVVXXSSSXSSZZZZZJJJJDFFDDBFRRRRYYYYYYYLLLPPPPPPPCCPCCAAAAANNNNNNNNNBBBBBBMHHH
HHHHHHHHHHHHHHHHBCCCCFCIIXXXXXFFFFFFFFTTTTTTTTTTLLLLLLXHHVVVVVVVVVVVSSSSSSSZZZZZJDDDFDDDDDDRRDAYLLLLLLLLPPPPPPPCCCCAAAAAANNNNNNNNNBBBMMBMHHH
HHHHHHHHHHHHHHHBCCCCCCCCCCXXXIIIIIIIIITTTTTTTTTTLLLLLLLVHVVVVVVVVVVDSSSSSSSZZZZZZZDDDDDDDDDDDDDLLLLLLLPPPPPPPPPPCCCAAAAAAAAAAAABBBBBBBMMMHHH
HHHHHHHHHHHHHHBBBCCCCIIIIIIIIIIIIIIIIITTTTTTLLLLLLLLLLLVVVVVVVVVVSSSSSSSSSSVSZZZZZDDDDDDDDDDDDLLLLLZLLPPPPPPPPPPPAAAAAAAAAAAAAABMMMMMMMMMMHH
HHHHHFHHHHHHHBBBBBCCCIIIIIIIIIIIIIIIIITTLLLLLLLLLLLLLLLVMVVVVVVVVSSSSSSSSSSSSZZZZZDDDDDDDDDDDDDLLLLZZLPPPPPPPPPPPAAAAAAAAAAAAAAAMMMMMMMMMMMM
CCFFFFHHHHHBBBPBBBBCCIIIIIIIIIIIIIIIIITTTTLLLLLLLLLLLVVVMVVVVVVSSSJSSSSSSSSSSUZZIZDDDDDDDDDDDKKKLLZZLLLPPPPPPPPPOAAAAAAAAAAAAAAAMMMMMMMMMMMM
CCFFFFFHHHHJBBBBBBCCCIIIIIIIIIIIIIIIIITVVVVLLLLLLLLLLLLVVVVVVVVVVSSSSSSSSSSSZUUZIIDDDDDDDDDDKKKKLZZZZKKKKPPPPZPPOOOAAAAAAAAAAAAAMMMMMMMMMMMM
CFFFFFFHHHHHBBBBBBBCCIIIIIIIIIIIIIIIIIZVVVVLVLLLLLLBLLLVIVVVVVVVSSSSSSSSSSSSUUUUUDDDDDDDDDDKKKKKKKKKZZAKKPPZZZZOOOOOAAAAAAAAAMMMMMMMMMMMMMMM
CFFFFFFHHHHHBBBBBXBBCIIIIIIIIIIIIZZZZZZVVVVVVLLLLLLBBIIIIVVVVVVSSSSSSSSSSSSSUUUUUUUDDDDDDDDKKKKKKKKKKKKKZZZZZZZZOOOOAAAAAAAAAAMAMMMMMMMMMMMM
FFFFFFFFFHHFFBBBXXBBIIIIIIIIIIIIIZZZZVVVVVVVLLLLLLLLBBIIIIVVPVVSSSSSSSSSSUUUUUUUUUUDDDDDDDDDDKKKKKKKKKKKZZZZZZZZOOOOOOAAAAAAAAAAMMMMMMMMMMMM
FFFFFFFFUFFFBBBBBBBBIIIIIIIIIIIIIZZZZVVVVVVVLLLLLLLBBBBIIIPUPVPKSSSSSSSSSSUUUUUUUUUDDDDDDDDDPKKKKKKKKKKKKZZZZZZOOOOOOOAAAAAAVVAAMMMMMMMMMMMM
FFFFFFFFFFBBBBBBBBJJIIIIIIIIIIIIIZZZZZVVVVVVVLLLLLLLBBIIIPPPPPPSSSSSSSSSUUUUUUUUUUUDDDDDDDDDPPPKKKKKKKKKKZZZZZZOOOOOOOTTHAAVVVVVMCMMMMWMMMMM
FFFFFFFFFBBBHBBBBJJJIIIIIIIIIIIIIZZZZZYVVYYVVVVLLLLLBBIIIIPPPPPPPZSSSSSSUUUUUUUUUUUUDDDDDDDPPPPKKKKKKKZZKZZZZZZOOOOOOTTTHHHVHHVMMMMMMMMMLMMM
FFFFFFFFXBBBBBBBBBJJIIIIIIIIIIIIIZZZZNYVYYYYYYVVLLLLIIIIIIIPPPPPPZSSSSESUUUUUUUUUUUUUDDDDPPPPPPKKKKKKKKZZZZZZZZOOOOOOOTTHHHHHHVHCCCCMMMMMMMM
FFFFFFFFFBBBBBBBBBBBIIIIIIIIIIIIIZZZZYYYYYYYYYYVLLILIIIIIIPPPPPPPPPSSSUUUUUUUUUUUUUUUDDDDPPPPPPKKKKKKZZZZZZZOOOOOOTTTTTTAAHHHHHHCCCCCCMMMMMM
FFFFFFFFFBBBBBBBBBBBIIIIIIIIIIIIIZZZZZYYYYYYYYYYYLIIIIIIIIPPPPPPPPPPASUUUUUUBUGUUUUBUJJJJJJJJJJPPKKBZZZZZZZOOOOOTOTTTTTTAAHHHHCCCCCCCCMCMMMM
FFFFFFFFFFBBBBBBBBBBIIIIIIKKZZZZZZZQQYYYYYYYYYYYYIIIIIIIIPPPPPPPPPPPAAUUUUBBBBUUULBBUJJJJJJJJJJPPKKKZZOZZZOOOOOOTTTTTTTTTHHHHHCCCCCCCCCCMMCC
FFFFFFFCWWBBBBBBSBBBIIIIKYKKZZZZZZQQQYYYYYYPYYYIIIIIIIIIIPPPPPPPPPAAAUUUUUVVBBBUUUBBBJJJJJJJJJJPPPKAZZOOOOOOOOOOOTTTTTTLLLHHHHHCCCCCCCCCCMCC
FFFVVVWWBWNWBSSSSBSSIIIIKKKKZZZZZZQQQYYYYYYPPPYIIIIIIIIIIIPPPPPPPPPPAUUAAAVVVVBBBBBBBJJJJJJJJJJPPPOOOOOOOOOOTTOOTTTTTTTLLLLHHHHCCCCCCCCCCCCC
QQFFVVWWWWWWBSSSSSSSSKKKKKKKZZZZZZZZQZZYYYYPPPPIIIIIIIIIIIPPPPPPPPPPAAUAAAVVVBBBBBBBBJJJJJJJJJJPYPOOOOOOOOOOOTTTTTTTTTTTTLLHLHHCCCCCCCCCSSCC
QWFVVVWWWWWWBBSSSSSSSKKKKKKKOOZZZZZZZZZIYYPPPPPVVIIIIIIIIIIPPAPPPAAAAAAAAVVVVBBBBBBBBJJJJJJJJJJPOOOOOOOOOOOOTTTTTTTTTTTTLLLLLLLLLLCCCCCCSSSS
QWVVWWWWWWWWWOSSSSSSKKKKKKKKKKZZZZZZZZZIIPPPPPPVVIIIIIIIIIINPPPAAAAVVAAAAVVVVJJJJBBBBJJJJJJJJJJMMOOOOOOOOOOOTTTTTTTTTTTLLLLLLLLLLLLCCCCCSSSS
WWWWWWWWWWWWWOOSSSSSKKKKKKKKKZZZZZZZZQIIIIPPPPVVDIIIIIIIIIIISSSAAAVVVVVVVVVVVJJJJBBBBJJJJJJJJJJMMNOOOOOOOOOETTTTMTTTTTTLLLLLLLLLLLLLLCSSSSSS
WWWWWWWWWWWWWWSXSSSSKKKKKKKKKKZZZZZZZZIIIIIGGGVVDDIIIIIIIIISSSSASAAVVVVVVVVVVJJJJJJJJJJJJJJJJJJNNNNONNNOOEEETTTTMTTTTTTLLLLLLLLLLLLLASSSSSSS
WWWWWWWWWWWWWWSSSSSSSKKKKKKKZZZZZZZZIIIIIGGGGGGVVVVVVIIVTTTSSSSSSAAAVMSVVVVVVJJJJJJJJJJJJJJJJJJNNNNNNNNOEEEEBBTTMTTTTTTLLLLLLLLLLLLLLLSSSSSS
WWWWWWWWWWWWWWSSSSSSSSKKKZKZZZZZZZIIIIIIIGGGGGVVVVVVVVVVTTTSSSSSSSSSSSSVVVVVVJJJJJJJJJJIIIIINNNNNNNNNNNNNEEEBBTMMTTTTTTTTLLLLLLLLLLLLLMMSSSN
WWKWWWWWWWWWWWWSSSSSHHKKKZZZZZZZZZIIIIIIIGGUGGVVVVVVVVVVVVTTSSSSSSSSSSSVLVVVVJJJJJJJJJJIIIIINNNNNNNNNNNNNEEEEEEMMMTTAAAALLLTTLLLLLLLLLMMMXXN
WWWWWWWWWWWWWWTSJJJSJHKKKYZZZZZZZIIIIIIIGGGVVVVVVVVVVVVVVVVTTSSSSSSSSSLLLVVVVJJJJJJJJJJIIIUINNNNNNNNNNNNNEEEEMMMMTTTAAAALTTUTTTLLLTXXMMMMXXX
WWWWWWWWWWWWWWTJJJJJJHKKYYYZOZZZZZIIIIIGGGVVVVVVVVVVVVVVWVDDDSSSWSSLLSLLLLVVVJJJJJJJJJJLIINNNNNNNNNNNNNNNEEEEEEMMMTMTAAAATTUTTTTLLTTXMMXXXXX
WWWFWWWWWMMMWMJJJJJJJJJYYYYZZZOZIIIIIIIIGGVVVVVVVVVVVVVVWWDDDDDWWSAALLLLLLLLLJJJJJJJJJJLIDNNNNNNNNNNNNSNNEEEEEMMMMMTTAAAATTTTTTTTTTTXXMXXXXX
WFFFMMMMMMMMMMJJJJJJJLJJJYYYYZZIIIIIIIIIIVVVVVVVVVVVMVVDDDDDDDDDDDDAAALLLLLLLLLLLLLLLLLLNNNNNNNNNNNNNNSNNNEFFPTTMTMTTTATATTTTTTTTTTXXXXXXXXF
WFFFMMMMMMMMMMJJJJJJJJJJJYYYYIZIIIIIIIIIZVVVVVVVVVMMMMDDDDDDDDDDDAAAALLLLLLLLLLTTGGLLLNNNNNNNNNNNNSNSJSSTTEFFPTTTTTTTTATTTTTTTTTTTTXXXXXCXFF
WFFFFRRRRRRRJJJJJJJJJJJJJJYYIIIIIIIIIIIVVVVVVVVVVVMMMMDDDDDDDDDDDAATLLLLLLTLLLTTPGGLLLLNNNNNNNSNSSSSSSSSTSFFFPTTTTTTTTTTTTTTTTTTTTXXXXXXXXFF
FFFFFRRRRRRRGJJJJJJJJJJJJJIIIIIIIIIIIIIDVVVVVVVVMMMMMMDDDTTTTDDDTAATTLLLLLTLTTTTGGGLLNNNNGGNSSSSSSSSSSSSSSFFPPTPMTTTTTTTTTTTTTTTTTXXXXXXXXFF
FFFFFFRRRRRRRRUJJJJJJJJJJJIYYYIIYIIIIIIVVVVVVVVMMMMMMDDDDTTTTDDDTTTTTLLLLLTTTTTTTGGGGGGGGGGGSSSSSSSSSSSSSPPPPPPPPPXTTTTTTTTTTTTTTTTXXXEXXXFF
FFFFFFFRRRRRRRRJJJJJJJJYJYYYYYYIIIIIIIMMVMVVVVMMMMMMMDDDDTTTTDDTTTTTTTTLTTTTTTTTTGGGGGGGGGGGSSSSSSSSSSSSPPPPPPPPPPTTTTHHHHHTTYTTWWWXWEEEEEEE
FFFFFFFFFRRRRRRJJJJJJJJYYYYYYYIIIIIJIMMMMMMMVVMMMMMMMDDDDTTTDDRTTTTTTTTTTTTKTTTWWWGGGGGGGGGGGGGSSSSSSSSSPPPPPPPPPPTTTHHHHHHTTYYIYWWWWWWWEEEE
FFFFFRRRFRRRRRRRJJJJJJYYYYYYYYIIIIIJIUUMMMMMMMMMMMEDDDDDDTTTDDDTTTTTTTTTTKKKTTTKKKGGGGGGGGGVGGGSSSSSSSSSPPPPPPPPPPPHHHHHHHHYYYYYYWWWWWWWWEEE
QFFFMRRRRRRRRRRRRRQQQJJYYYYYYYYIIIIUUUUUUUUUMMMMMEEEEEEDDTTTDDDDTTTTTTTTTKKKKKTKKKKKGGGGGGVVVVSSSSSSSSSSPPPPPPPPPPPHHHHHYYYYYYYYYWWWWWWWWWED
QFMMMRRRRRRRRRRRRRRQYYYYYYYYYYYYYYYUUUUUUUUUMMEEEEEEEEEETTTTDDDDDTTTTTTTKKKKKSKKKKKKGGGVVVVVVVVWSSSSSSSSSSPPPPPPPPHHHHHHYYYYYYYYYWWWWWWWWWWW
QQQQQRRRRRRRRRRRRRRRYYYYYYYYYYYYYYUUUUUUUYUUUMEEEEEEEEEETTTTDDDKJJJJTTTTKKKKKKKKKKKKGGGVVVVVVVVWWSSSSSSSSSPPPPPPPPPHHHYYYYYYYYYYYYWWWWWWWWWW
QVVVQCRRRRRRRRRRRRRRYYYYYYYYYYYYYUUUUUUUUUUMMMEEEEEEEEEETTTTDRDKJJJJTTTTKKKKKKKKKKKKGGGGZVVVVVVWWWSMMSSSSSPPPPPPPPHHHHYYYYYYYYYYYYYWWWWWWWWW
VVVVVRRRRRDRRRRRRRRRYYYYYYYYYYYYUUUUUUUUUUUMMMEEEEEEEEEETTTRRRRRJJJJJJJTTKKKKKKKKKKKHGGZZVVQUXWWWWWMMMMMSSPPPPPPPPHHHYYYYYYYYYYYYYYWWWWWFWWP
VVVVRRRRRDDDRRRVRYYYYYYYYYYYYYYYYYYUUUUUUMMMMEEEEEEEEEEETTTRRRRVJJJJJJJTTQQKKKKKKKFKHHQQQQQQXXWWWWWWUMMMSPPPPPPPPPHHHHYYYYYYYYYYYYWWWWWWFWWP
VVVVVNNDDDDRRRRVVYYYYYYYYYYYYYYYYYYEUUUUUMMMMEEEEEEEEEEEERRRRRRVJJJJJJJQQQQQKKKKKKKZKHHQQQQXXXWXWWWUUMMMMPPPPPLLPPLLHHYYYYYYYYYYYJWWWWFFFWFS
VVVVVNNNDDVYRVVVVYYYYYYYYYYYYYYEEEEEEUUUUUMMMMEEEEEEEEEEEEERRRRRJJJJJJJQQQQQKKKKKKKKKKQQQQQXXXXXWWUUUPPPPPPPPPLLLLLLHLYYYYYYYYYYYWWWSGGFFFFS
VVVVVVNNDNVVVVVVVVVVYYYYYXYYYYYYEEEEEEUUMMMMMMEEEEEEEEEEEEQQQQRRJJJJJJJQQQQQKKKKKKKKMQQQQQQXXXXXXXUUUPPPPPPPPPPLLLLLLLLLLYYYYKYYYWISSGGGFFFS
VVVVVVNNNNVVVVVVVVVVVYYCXXYYYXYYEEEEEEEEEMMMMMEEEEEXEEREQQQQQQQVJJJJJJJQQQQPPKKKKKKKKQQQQQQXXXXXXXXXUXXPPPPPPPPLLLLLLLLLYYYYYKYYYYYSGGSSSSFS
VVVVVNNNNNFFVVVVVVVVVJJXXXXXXXXYYEEEEEEEMMMMMMMMMEEXXQQQQQQQQQQVJJJJJJJQQQQQKKKKKKKXXQQQQQXXXXXXXXXUUXXQQPPPPPPPLLLLLLLLKKKKKKKKYVSSSSSSSSSS
VVEVVINNNNFFFVVVVVVFFXXXXXXXXXYYYEEEEEEEEDDDDMDCMKKXXXQQQQQQQQQQJJJJJJJQQQQQKKKKKKXXXQQQXXXXXXXXXBBIXXXQQQPXSPPLLLLLLLLLKKKKKKKKSSSSSSSSSSSS
IIIIIIINNNFFFFFFFFFFXXXXXXXXXXXXYEEEEEEEDDDDDDDCKKKXXXQQQQQQQQQQJJJJJJJQQQQQKKKKKKXXXXXXXXXXXXXXBBBXXXXQQQSSSPPLLLLLLLLLKKKKKKKSSSSSSSSSSSSS
IIIIIINNNNFFFFFFFFFXXXXXXXXXXXXXEEEEEEEDDDDDDDDCKKKKXXQQQQQQQQQQQQQDQQQQQQXQKKKKXXXXXXXXXXXXXXXXBBBVXXXXQQSSSSYYLLLLLLLLKKKKKKKSSSSSSSSSSSSS
IIIIIIIIIFFFFFFFFFFFXXXXXXXXXXXXEEEEEEEEDDDDDDDDDKKQQQQQQQQQQQQQQQQDQQQQNQXQXXKXXXXXXXXXXXXXXXXXXXBXXXXXSSSSSSSYSSLLLILLKIIIKKKKKSSSSSSSSSSS
IIIIIIIIIZFFFFFFFFFXXXXXXXXXXXXXEEMEEEEDDDDDDDDKKKKQKQQQQQQQQQQQQQQQQQQQQQXXXXXXXXXXXXXXXXXXXXXXXXGXXXXXSSSSSSSSSIIIIIIIIIIIKKKKKKKKSSSSSSSS
IIIIIIIIIZZZOOOOFFFXXXXXXXXXXXXXMEMEEEEHDDDDDDDDDKKKKQQQQQQQQQQQQQQCQYYYYQMXXXXXXXXXXXXXXXXXFFXXXXXXXXXXSSSSSSSIIIIIIIIIIIIIKKKKKKKKSSSSSSSS
IIIIIIIIIZZZOOMMFFFFXXXXXXXXXMMMMMMREEEHHHDDDDDDDKKKKKQQQQQQQQQQQQDDDYDDDLMXXXXMXXXXXXXXXXXXFFXXXXXXXXXSSSSSSSUIIIIIIIIIIIIIKKKKKKKSSSSSSSSS
IIIIIIIIIZZZOOOOOOFFXXXXXXXXXMMMMMMMMEHHHDDDDDDDDKKKKIQQQQQQQQQQQQDDDDJDLLMMMMMMMMMMXXXXXXXXFFFXXXXXXXXSSSSSSSSIIIIIIIIIIIIIIIKKKKKKSSSSSSSD
IIIIIIIIZZZOOOOOOOFFXXXXXXXXXMMMMMMMHHHHHDDDDDDDDDKKKIQQQQQQQQQQQQDDDDDDDDMMMMMMMMMMXXYXXXXXFFFXXXXXXSSSSSSSSSSSSIIIIIIIIIIIIIKKKKKKBSSSKSDD
IIIIIIIIIZZOOOOOOOOFFXXXXXXXMMMMMMMMHHHKHKDDDDDKKKKKIIIIKICIQQAQQADDDDDDDMMMMMMMMMMMMYYXXXXFFFXXXXXXXXXSSBSSSSSSSIIIIIIIIIIIIKKKKKKKKZSSSDDD
IIIIIHIIZZZOOOOOOFOFFFFXXXXXMMMMMMMMMHHKKKDDDDDDKKKKIIIIIIIIQIILIIDDDDDMMMMMMMMMMMMMFYYYYXXXXXXXXXXXXXXSSSSSSSSSSIIIIIIIIIIIIIKKKKKKZZSSSDDD
SSIIIHHHHZHOOOOOFFFFFFXXXXXMMMMMMMMMMHHKKKDDDDDKKKKIIIIIIIIIIIIIIIDDDDDDMMMMMMMMMMMFFYYYYVVVVXXXXXXXXXXXSSSSSSSSSIIIIIIVVIITIIIIKKZZZZSSXDDD
SIISSHHHHHHOOOOOOOFFFFXXXXXXLMMMMMMMMHHKKKDDKDKKKKKKIIIIIIIIIIIIDDDDDDDMMMMMMMMRMFFFFYYVVVVVVVXXXXXXXXXMSSSSSSSSSSIIIIIVIITTITTIEZZFFZBBXDDD
SSISSSSHHHOOOOOOOFFFFFFXXXXLLMMMMMMHHHHKKKKKKKKKKKKIIIIIIIIIIIIDDDDDDDDMMMMMMMRRMFFFFYYVVVVVVVXXXXXXAAASSSSSCSSSSVVIVVVVQVTTITTTEEZZFFBXXDDX
SSSSDDDHHHDDDOOOOOXFFFFFXXXXLLMMMMMHSHHKKKKKCKKKKKKKIIIIIIIIIIIIDDDDDDMMMMMMMMMRMMFFFFVVVVVVVVVXXXXXXAASSSSSSFFSAVVVVVVVVVVTTTTEEEEFFFBXXDXX
SSSSDDDDHHDOOOOODDXFFFFFXXXXXXXMQSHHSSHCCDCCCKKKKKKKIIIIIIIIIIIIDDDDBBMMMMMMMMMMMMFFFFVVVVVVVVTTXXXDAAAAASSSSFASAVVVVVVVVVVVVVTEOEEBFBBXXXXX
SSSSDDDDHHDDDDDDDDXXXXXXXXXXXXXSSSSSSSHCCDDCCKKKKKKKIIIIIIIIIIBDDBBBBBMMMBBMMMMMMFFFFFVVVVVVVTTTTXGTTAAAAAAASAAAAVVVVVVVVVVVVEEEEEEBBBXXXXXX
SSSWWWDDDDDDDDDDDXXXXXXXXXXXXXSSSSSSSSSSCCCCCCCKKKKKKIIIIIIIAABBBBBBBBBMMBBBMMMMMMFFFVVVVVVTTTTTTTTTTTAAAAAAAAAAAAVVVVVVVVVVVVEEEEEEBBXXXXXX
SSSWWWWDDDSDDDDDDDXXXXXXXXXXXXSSSSSSSSSSCCCCCCCCKKKOOOXIIIOAAAAAABBBBBBMMBBBMMMFFFFFFFVVVVHTTTTTTTTTTTTAAAAAAAAAAZVVVVVVVVVVVVBEEEBBBBBXXXXX
SSSWWLLSSSSDDDSSDMMMMXXXXXXXXXSSSSSSSSSSSCCCCCCCCKKOOOOIIIOAAAAAABBBBBBBBBBBMBFFFFFFFFVVVVVFFTTTTTTTTTTTAAAAAAAAAAVVVVVVVVVVVVBBBBBBBBBXXXXX
SSSSWSSSSSDDDSSSMMMMXXXXXXXXXXJSJSSSSSSSSCCCCCCCKKKOOOOOOOOOOAAAABBBBBBBBBBBBBFFFFFFFFFFFFFFTTTTTTTTTTTTFFAAAAAAAAVVVVVVVVVVVVVBBBBBBBBXXXXX
SSSSSSSSSSSSSSSMMMMMMMXXXXXXXJJJJSSSSSSSSCCCCCCCKKOOOOOOOOOOOAAAABBBBBBBBBBBBBFFFFFFFFFFFFFFTTTTTTTTTTTFFFFAAAAAAAAAVVVVVVVVVVBBBBBBBBBXXXXX
SSSSSSSSSSSSSSSMMMMMMMXXXVXXXJJJJSSSSSSSSCCCCCCKKKKOOOOOOOOOOAAAABBBBBBBBBBBBBFFFFFFFFFFFFTFFTTTTTTTTTFFFFFAAAAAAAAAVVVVVVVVBBBBBBBBBBBBBXXX
SSSSSSSSSSSSSSSMMMMMMMXXXVVXJJJJJSSSSSSSCCCCCCCKKKOOOOOOOOOOOAABBBBBBBBBBBBBBBFFFFFFFFFFFTTTTTTTTTTTTTFFFFFFKAAAAAAAVVVVVVVVVBBBBBBBBBBBBBBX
SSSSSSSSSSSSSSKMMMMMMMMMMVVXXPPJSSSSSSSSSSSCCCCCCKOOOOOOOOOOAAAABBBBBBBBBBBBBBFFFSFFFFFFFTTTTTTTTTTTTTFFFFFAAAAAAAAAUVVVVVVVBBBBABBBBBBBBBBB
SSSSSSSSSSSSSSSSMMMMMMMMMMMKXPPPSSSSSSSSSSSSKCOCKKKKKZOOOOOOOAAAAABBBBBBBBBBQBFFSSSSFFFFFFTTTTTTTTTTTTFFFFFFASSSAAUUUVVVVBBBBBBAABBABBBBBBBB
IISSSSSSSSSSSSSSMMMMMCMMMWMKKPPPPPPSAASSSSSSKCKKKKKKKZOOOOOAAAAAAABBBBBBBBBBBBFSSSSSFFFFFFTFTTTTTTTTTTFFFFFFFFFFUUUUUUVUUBBBBBBAAAAAAAAABBBB
IISISSSSSSSSSSSMMMMMMCNCWWWNNNPPPPAAAASSSSSCKCCKKKKKAZOLOAAAAAAAAAAABBBCCBBSFFFSSSSSFFFFFFFFFFFTTTTTTTFFFFFFFFFFFUUUUUVVUUUBBBROAAAAAABBBBBB
IIIIISSSSUUSSOSMMMMCCCNCWWWNNNPPNPNNAASSSSSCCCCCHHKHAAAAOAAAAAAAAAABBBBCCCSSSSSSSSSSSFFFFFFFFFFFKTTTTTFFFFFFFFFFFUUUUUUUUUUUURRRRAAAAABBBTTT
IIISSSSUUUUUSUMMMMMCCCCCCWWNNNNPNXNAASSSSSSCCCCCCHKHAAAAAAAAAAAAAAAAABBBSSSSSSSSSSSSSFFFFFFFFFFKKKFFFFFFFFFFFFFFFUUUUUUUUUUURRRRBAAAAAAATTTT
IIISISSUUUUUUUMMMMCCCCCCCCCCNNNNNNNNNSSSSCCCCCCCCHHHHAAAAAAAAAAAAAAAAAGBISSVVSSSSSSSFFFFFFFFFFFFFFFFFFFFFFFFFFFFFUUUUUUUURRRRRRRRRRRAAAAATTT
IIIIIIUUUUUUUUMUMMCCCCCCCCYNNNNNNNNSSSSSSSCCCCCHHHHHHHHAAAUAAAAAAAAOAABBBVVVVVSSSSSSSFFFFFFFFFFFFFFFZFFFFFFFFFFFFUUUUUUUUURRRRRRRRRRAATTTTTT
PPPIPPIUUUUUUUUUMCCCCCCCCCCNNNNNNNNSSSSSSSSCCCHHHHHHHHUUUUUUUAAAAAGOGABBBBDDDVSYFFSFFFFFFFFFFFFFFFFFZFFFFFFFFFFFUUUUUUUURRRRRRRRRRRAATTTTTTT
PPPPPPUUUUUUUMMMMMMCCCCCCCCCNNNNNNNNMMSSSSSCCCTHHUUHHHUUUUUUUUAAAAGOGBBBBDDDDDFYYFFFFFFFFFFFFFFFFFZZZZZZFFFFFFFFFUUUUUUURRRRRRRRRRRAAAATTTTT
PPPPPPUUUUUUUUMMMMCCCCCCCCCCCNNNNNMMMMMSSSSCQTTTTUUUUUUUQUUUUUAAAGGGGBBBBDDDDFFFFFFFFFFFFFHHHFFFZZZZZZZZZFFFFFFFFUUUUUUUURRRRRRRRRRAAAAATTTT
PPPPPPPUPUUUUAMMMMCCCCCCCCCNNNNNNNMMMMMMSSSSTTTTUUUUUUUUUUUUUUAAGGGGBDDDDDDDDFFFFFFHHFFHHHHHZZZFZZZZZZZYYOOOFFUUUUUXXXXURRRRRRRRRRRRCCAATTTT
PPPPPPPPPUPUUPPMMMCCCCCCCCCCNNNNNNMMMMMMMSSSTTTTUUUUUUUUUUUUUUGGGGGGDDDDDDDDDDDDDDDHHHFFHHHHHHZZZZZZZYYYYOYOFFUUUUUXXXXXXRRRRRRRRRCCCCAAAAAA
PPPPPPPPPPPPPPTMMMGCCCCCCCCCNNNNNNMMMMMMSSTTTTTTTFUUUUUUUUUUUGGGGGGGDDDDDDDDDDDDDDHHHHHFHHHHHZZZZZZZYYYYYYYYUUUUUUXXXXXXXXRRRRRRRRCCCCCAAAAA
PPPPPPPPPPPPPPPGGGGGCCCCCCCCNNNNNNNMMMSMSSTTTTTTTTTUUUUUUUUUUVGGGGGGDDDDDDDDDDDDDDHHUHHHHHHHHHZZZZZZYYYYYYYUUUUUUUXXXXXXXRRRRRRRRRCCCCCCAAAA
GPPPPPPPPPPPPPPGGGGGGCCCCCHNNNNNHHHMMSSSSTTTTTTTTTUUUUUUUUUGGGGGGGGGGDDSDDDDDDDDDDDHHHHHHHHHHHZZZZZYYYYYYYYUUUUUXXXXXXXXXRXXXRRRCCCCCCCAAAAA
PPPPPPPPPPPPPPPGGGGGGCCCHHHNNNNNHMMMMMMSSTTTTTTTTTTTUUUUUVVGGGGGGGGGGDDDDDDDDDDDDDHFHHHHHHHHHHZZZYZYYYYYYYYYYUXXXXXXXXXXXXXXXXRRRRBCCCCAAAKA
PPPPPPPPPPPPPPGGGGGGGCGHHHHNNNNNHMMMMMMTTTTTTTTTTTTTTUUUUUUGGGGGGGGGGGDDDDDDDDDDDDHHHHHHHHHHZZZZZYYYYYYYYYYYYUXXXXXXXXXXXXXXXXRRRRCCCCCAAAAA
PPPPPPPPPPPPGGGGGGGGGGGHHHHHHHNNHHMMMMMSTTTTTTTTTTTTTTUUTWUGGGGGGGGGGGDDDDDDDDDDDDHHHHHHHHHHHHZZZYYYYYYYYYYYYYZXXXXXXXXXXXXXXOORORCCCCCCOOOO
PPPPPPPPPPPPPGGGGGGGGGGGGHHHHHNHHMMMMMMSSTTTTTTTTTTTTTTUTWWGGGGGGGGGDDDDDDDDDDDDDDDHHHHHHHHHHZZZZYYYYYYYYYYYMYXXXXXXXXXXXXXXOOOROOOOOOOOOOOO
RRPYPRPPPPPPPGGGGGGGGGGGGGHHHHHHHHHMFMSSSTTTTTTTTTTTTTTTTTTYYGGGGGGGDDDDDDDDDDDDDHHHHHHHHHHHHZZZZZYYYYYYYWYMMXXXXXXXXXXXXXXXOOOOOOOOOOOOOOOO""")
# Example2
panel_3 = Panel("""RRRRIICCFF
RRRRIICCCF
VVRRRCCFFF
VVRCCCJFFF
VVVVCJJCFE
VVIVCCJJEE
VVIIICJJEE
MIIIIIJJEE
MIIISIJEEE
MMMISSJEEE""")
# Example1
panel_4 = Panel("""OOOOO
OXOXO
OOOOO
OXOXO
OOOOO""")
characters = Characters(Text=panel_3)  # -> simplify(Result), Unicode
# Part 2 examples
panel_5 = Panel("""EEEEE
EXXXX
EEEEE
EXXXX
EEEEE""")
panel_6 = Panel("""AAAAAA
AAABBA
AAABBA
ABBAAA
ABBAAA
AAAAAA""")
c_script = CSharpScript(CharTree=characters.Result)  # -> out, coordinates, character; inputs CharTree: tree of String
# ---------- c_script: C# ----------
// Grasshopper Script Instance
#region Usings
using System;
using System.Linq;
using System.Collections;
using System.Collections.Generic;
using System.Drawing;

using Rhino;
using Rhino.Geometry;

using Grasshopper;
using Grasshopper.Kernel;
using Grasshopper.Kernel.Data;
using Grasshopper.Kernel.Types;
#endregion

public class Script_Instance : GH_ScriptInstance
{
    #region Notes
    /* 
      Members:
        RhinoDoc RhinoDocument
        GH_Document GrasshopperDocument
        IGH_Component Component
        int Iteration

      Methods (Virtual & overridable):
        Print(string text)
        Print(string format, params object[] args)
        Reflect(object obj)
        Reflect(object obj, string method_name)
    */
    #endregion

    private void RunScript(
	DataTree<string> CharTree,
	ref object coordinates,
	ref object character)
    {
    List<Point3d> centers = new List<Point3d>();
    List<string> characters = new List<string>();

    int maxHeight = CharTree.BranchCount;

    // Iterate over each branch of the tree
    for (int i = 0; i < CharTree.BranchCount; i++)
    {
        List<string> currentBranch = CharTree.Branch(i);

        // Iterate over each item in the current branch
        for (int j = 0; j < currentBranch.Count; j++)
        {
            double x = j + 0.5;
            double y = maxHeight - i - 0.5;

            // Create a point at the center of the rectangle
            Point3d center = new Point3d(x, y, 0);
            centers.Add(center);
            characters.Add(currentBranch[j]);
        }
    }

    // Set output variables
    coordinates = centers;
    character = characters;
    }
}
# ---------- end c_script ----------
xy_plane = XYPlane(Origin=c_script.coordinates)
rectangle = Rectangle(Plane=xy_plane, XSize="-0.5 to 0.5", YSize="-0.5 to 0.5", Radius=0)  # -> Rectangle, Length
create_set = CreateSet(List=flatten(c_script.character))  # -> Set, Map
list_length = ListLength(List=create_set.Set)
boundary_surfaces = BoundarySurfaces(Edges=rectangle.Rectangle)
create_tree = CreateTree(Data=boundary_surfaces, Path=create_set.Map)
gradient = Gradient(
    LowerLimit=0,
    UpperLimit=list_length,
    Parameter=create_set.Map,
    stops=[0: RGB(48, 18, 59), 0.0312: RGB(57, 41, 114), 0.0625: RGB(64, 64, 161), 0.0938: RGB(68, 86, 199), 0.125: RGB(70, 107, 227), 0.156: RGB(70, 127, 246)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])  # disabled
brep_join = BrepJoin(Breps=create_tree)  # -> Breps, Closed
list_length_2 = ListLength(List=flatten(brep_join.Breps))
brep = Brep(flatten(brep_join.Breps))
series = Series(Start=0, Step=1, Count=list_length_2)
custom_preview = CustomPreview(Geometry=boundary_surfaces, Material=gradient)  # disabled
brep_edges = BrepEdges(Brep=brep_join.Breps)  # -> Naked, Interior, NonManifold
gradient_2 = Gradient(
    LowerLimit=0,
    UpperLimit=list_length_2,
    Parameter=series,
    stops=[0: RGB(48, 18, 59), 0.0312: RGB(57, 41, 114), 0.0625: RGB(64, 64, 161), 0.0938: RGB(68, 86, 199), 0.125: RGB(70, 107, 227), 0.156: RGB(70, 127, 246)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])
curve = Curve(brep_edges.Naked)
area = Area(Geometry=brep_join.Breps)  # -> graft(Area), Centroid
join_curves = JoinCurves(Curves=curve, Preserve=False)
length = Length(Curve=join_curves)
mass_addition = MassAddition(Input=length)  # -> Result, PartialResults
panel_7 = Panel(area.Area)
multiplication = Multiplication(A=mass_addition.Result, B=area.Area)
panel_8 = Panel(mass_addition.Result)
mass_addition_2 = MassAddition(Input=flatten(multiplication))  # -> Result, PartialResults
panel_9 = Panel(multiplication)
panel_10 = Panel(mass_addition_2.Result)
custom_preview_2 = CustomPreview(Geometry=brep, Material=gradient_2)
panel_11 = Panel("""884354
was too low""")

# ----
# Part2
discontinuity = Discontinuity(Curve=join_curves, Level=1)  # -> Points, Parameters

list_length_3 = ListLength(List=discontinuity.Parameters)
shift_paths = ShiftPaths(Data=list_length_3, Offset=Slider(-2, range=-2..0))
mass_addition_3 = MassAddition(Input=shift_paths)  # -> Result, PartialResults
panel_12 = Panel(list_length_3)
panel_13 = Panel(mass_addition_3.Result)

multiplication_2 = Multiplication(A=mass_addition_3.Result, B=area.Area)
mass_addition_4 = MassAddition(Input=flatten(multiplication_2))  # -> Result, PartialResults
panel_14 = Panel(mass_addition_4.Result)
